# Dynamo graph Classification - NaiveBayes.dyn (Dynamo 2.0.2.6826)

# group: Inputs
training_data = CodeBlock()
# ---------- training_data.designscript (16 lines) ----------
[
[ "Sunny", "Hot", "High", "Weak", "No" ],
[ "Sunny", "Hot", "High", "Strong", "No" ],
[ "Overcast", "Hot", "High", "Weak", "Yes" ],
[ "Rain", "Mild", "High", "Weak", "Yes" ],
[ "Rain", "Cool", "Normal", "Weak", "Yes" ],
[ "Rain", "Cool", "Normal", "Strong", "No" ],
[ "Overcast", "Cool", "Normal", "Strong", "Yes" ],
[ "Sunny", "Mild", "High", "Weak", "No" ],
[ "Sunny", "Cool", "Normal", "Weak", "Yes" ],
[  "Rain", "Mild", "Normal", "Weak", "Yes" ],
[  "Sunny", "Mild", "Normal", "Strong", "Yes" ],
[  "Overcast", "Mild", "High", "Strong", "Yes" ],
[  "Overcast", "Hot", "Normal", "Weak", "Yes" ],
[  "Rain", "Mild", "High", "Strong", "No" ]
];
# ----------------------------------------
# note: In this exercise, we will be using the famous Play Tennis example by Tom Mitchell (1998). In Mitchell's example, one would like to infer if a person would play tennis or not based solely on four input variables :
# - Outlook
# - Temperature
# - Humidity
# - Wind
# The rows of data presented below represent days on which the behavior of the person has been registered, pretty much building our set of observation instances for learning.
code_block = CodeBlock { [ "Outlook", "Temperature", "Humidity", "Wind", "PlayTennis" ]; }
code_block_2 = CodeBlock { "PlayTennis"; }

# group: Build machine
naiveBayesClassifier = AI.Algorithms.Classifier.NaiveBayesClassifier.NaiveBayesClassifier(inputMatrix=training_data, columnList=code_block, outputColumn=code_block_2)
code_block_3 = CodeBlock { "NaiveBayesMachine"; "Simple classifier machine"; }
withNameDescription = AI.Machine.WithNameDescription(algorithm=naiveBayesClassifier, name=code_block_3.out0, description=code_block_3.out1)

# group: Learn
learn = AI.Machine.Learn(machine=withNameDescription)

# group: The input value to test
validation_line = CodeBlock()
# ---------- validation_line.designscript (5 lines) ----------
["Overcast","Hot","High","Weak"];
 // result should be : yes

["Sunny","Hot","High","Weak"];
 // result should be : no
# ----------------------------------------

# group: Predict
predict = AI.Machine.Predict(machine=learn, testData=validation_line.out0)

# group: Inspect
watch = Watch(predict.Result)
