# Dynamo graph Regression - Multiple Linear.dyn (Dynamo 2.0.2.6826)

# group: Inputs
code_block = CodeBlock { name="NaiveBayesMachine"; desc="simple machine"; file="AI IO test -"+name+" (trained).json"; }
# note: Inputs
code_block_2 = CodeBlock()
# ---------- code_block_2.designscript (16 lines) ----------
[
58698,
79699,
57849,
42261,
70305,
27614,
75715,
60786,
63625,
55631,
58266,
53099,
80921,
59105
];
# ----------------------------------------
code_block_3 = CodeBlock()
# ---------- code_block_3.designscript (16 lines) ----------
[
4100000,
2545662,
6393800,
2700000,
6135500,
2355700,
1069931,
6458346,
5575706,
5542872,
1104684,
2182716,
949840,
1685624
];
# ----------------------------------------
code_block_4 = CodeBlock()
# ---------- code_block_4.designscript (16 lines) ----------
[
365460,
445822,
342936,
394430,
422060,
269160,
474983,
462885,
496256,
406506,
565503,
450388,
697138,
452415
];
# ----------------------------------------
# note: Results
code_block_5 = CodeBlock()
# ---------- code_block_5.designscript (16 lines) ----------
[
3075,
2400,
1750,
1800,
1900,
1700,
1250,
2500,
2650,
3000,
1650,
1150,
1700,
3400
];
# ----------------------------------------

# group: Build list
create = List.Create(item0=code_block_2, item1=code_block_3, item2=code_block_4)
transpose = List.Transpose(lists=create)

code_block_6 = CodeBlock { ""; }

# group: Build machine
multipleLinearRegression = AI.Algorithms.Regression.MultipleLinearRegression.MultipleLinearRegression(inputList=transpose, outputList=code_block_5, codifyColumn=code_block_6)
byAlgorithm = AI.Machine.ByAlgorithm(algorithm=multipleLinearRegression)

# group: Learn
learn = AI.Machine.Learn(machine=byAlgorithm)

# group: The input value to test
code_block_7 = CodeBlock { [ 59000,1685000,45000 ]; }

# group: Predict
predict = AI.Machine.Predict(machine=learn, testData=code_block_7)

# group: Inspect
# note: Result should be
# 2179.216
watch = Watch(predict.Result)
predictionTime = AI.Machine.PredictionTime(machine=predict.Machine)
