# Dynamo graph Regression - Multivariate Linear.dyn (Dynamo 2.0.2.6826)

# group: Inputs
# note: In this exercise, we will be using the famous Play Tennis example by Tom Mitchell (1998). In Mitchell's example, one would like to infer if a person would play tennis or not based solely on four input variables :
# - Outlook
# - Temperature
# - Humidity
# - Wind
# The rows of data presented below represent days on which the behavior of the person has been registered, pretty much building our set of observation instances for learning.
code_block = CodeBlock()
# ---------- code_block.designscript (5 lines) ----------
[
[  1,  1,  1 ],
[  2,  1,  1 ],
[  3,  1,  1 ]
];
# ----------------------------------------
code_block_2 = CodeBlock()
# ---------- code_block_2.designscript (5 lines) ----------
[
[  2,  3 ],
[  4,  6 ],
[  6,  9 ]
];
# ----------------------------------------

# group: Build machine
multivariateLinearRegression = AI.Algorithms.Regression.MultivariateLinearRegression.MultivariateLinearRegression(inputList=code_block, outputList=code_block_2)
byAlgorithm = AI.Machine.ByAlgorithm(algorithm=multivariateLinearRegression)

# group: Learn
learn = AI.Machine.Learn(machine=byAlgorithm)

# group: The input value to test
code_block_3 = CodeBlock()
# ---------- code_block_3.designscript (4 lines) ----------
[
[  2,  1,  1 ],
[  3,  1,  1 ]
];
# ----------------------------------------

# group: Predict
predict = AI.Machine.Predict(machine=learn, testData=code_block_3)

# group: Inspect
watch = Watch(predict.Result)
