# Dynamo graph Regression - Simple Linear.dyn (Dynamo 2.0.2.6826)

# group: Training Data
input_values = CodeBlock()
# ---------- input_values.designscript (10 lines) ----------
[500,
3500,
4400,
4700,
5400,
3700,
6200,
5200,
6600,
6600];
# ----------------------------------------
corresponding_output_values = CodeBlock()
# ---------- corresponding_output_values.designscript (10 lines) ----------
[1000000,
1600000,
2200000,
2500000,
3100000,
3300000,
3500000,
2600000,
3000000,
4000000];
# ----------------------------------------

# group: Constructor
code_block = CodeBlock { "TestMachine #1"; "simple machine"; }
simpleLinearRegression = AI.Algorithms.Regression.SimpleLinearRegression.SimpleLinearRegression(inputList=input_values, outputList=corresponding_output_values)
byAlgorithm = AI.Machine.ByAlgorithm(algorithm=simpleLinearRegression)

# group: Learn
learn = AI.Machine.Learn(machine=byAlgorithm)

# group: Predict new values
# note: Our machine has never before seen this particular value as input, so it will have to predict what the corresponding output value is.
# This is essentially what all the learning is about, being able to handle new scenarios.
code_block_2 = CodeBlock { 4506; }
predict = AI.Machine.Predict(machine=learn, testData=code_block_2)

# group: Inspect
GUID = AI.Machine.GUID(machine=byAlgorithm)
getAlgorithm = AI.Machine.GetAlgorithm(machine=byAlgorithm)
isTrainingDataLoaded = AI.Algorithms.Regression.SimpleLinearRegression.IsTrainingDataLoaded(simpleLinearRegression=getAlgorithm)
