# Dynamo graph Clustering - KMeans.dyn (Dynamo 2.0.2.6826)

# group: Inputs
code_block = CodeBlock()
# ---------- code_block.designscript (11 lines) ----------
[
[-5,-2,-1],
[-5,-5,-6],
[2,1,1],
[1,1,2],
[1,2,2],
[3,1,2],
[11,5,4],
[15,5,6],
[10,5,6]
];
# ----------------------------------------
number_of_clusters = IntegerSlider(3, range=1..10 step 1)

# group: Build machine
withTrainingData = AI.Algorithms.Clustering.KMeans.WithTrainingData(inputList=code_block, clusters=number_of_clusters)
byAlgorithm = AI.Machine.ByAlgorithm(algorithm=withTrainingData)

# group: Learn
learn = AI.Machine.Learn(machine=byAlgorithm)

# group: The input value to test
code_block_2 = CodeBlock()
# ---------- code_block_2.designscript (2 lines) ----------
// For clustering, this input is ignored
null;
# ----------------------------------------

# group: Predict
predict = AI.Machine.Predict(machine=learn, testData=code_block_2)

# group: Inspect
# note: Result should be
# 1
# 1
# 2
# 2
# 2
# 2
# 0
# 0
# 0
watch = Watch(predict.Result)
predictionTime = AI.Machine.PredictionTime(machine=predict.Machine)
