# Dynamo graph Regression - Multivariate Linear.dyn "AI learn test - Multivariate Linear Regression" (Dynamo 2.0.2.6826)

# group: Inputs
# note: In this exercise, we will be using the famous Play Tennis example by Tom Mitchell (1998). In Mitchell's example, one would like to infer if a person would play tennis or not based solely on four input variables :
# - Outlook
# - Temperature
# - Humidity
# - Wind
# The rows of data presented below represent days on which the behavior of the person has been registered, pretty much building our set of observation instances for learning.
code_block = CodeBlock()
# ---------- code_block.designscript (5 lines) ----------
[
[  1,  1,  1 ],
[  2,  1,  1 ],
[  3,  1,  1 ]
];
# ----------------------------------------
code_block_2 = CodeBlock()
# ---------- code_block_2.designscript (5 lines) ----------
[
[  2,  3 ],
[  4,  6 ],
[  6,  9 ]
];
# ----------------------------------------

# group: Build machine
multivariateLinearRegression = AI.Algorithms.Regression.MultivariateLinearRegression.MultivariateLinearRegression(inputList=code_block, outputList=code_block_2)
code_block_3 = CodeBlock { "MultivariateMachine"; "Complex machine"; }
machine = AI.Machine.Machine(algorithm=multivariateLinearRegression, name=code_block_3.out0, description=code_block_3.out1)

# group: Learn
learn = AI.Machine.Learn(machine=machine)

# group: The input value to test
code_block_4 = CodeBlock()
# ---------- code_block_4.designscript (4 lines) ----------
[
[  2,  1,  1 ],
[  3,  1,  1 ]
];
# ----------------------------------------

# group: Predict
predict = AI.Machine.Predict(machine=learn, testData=code_block_4)

# group: Inspect
watch = Watch(predict.Result)
