# Dynamo graph AI constructor test - load.dyn (Dynamo 1.3.0.875)

# group: Folder
file_path = Filename(".\AI constructor test.json")

string = StringInput("AI IO test - Simple Linear Regression.json")

# group: IO
directoryName = FilePath.DirectoryName(file_path)
combine = FilePath.Combine(directoryName, string)

# group: Deserialise
loadModel = AI.Machine.Machine.LoadModel(combine)

# group: Inspect
name = AI.Machine.Machine.Name(loadModel)
GUID = AI.Machine.Machine.GUID(loadModel)
description = AI.Machine.Machine.Description(loadModel)
getAlgorithm = AI.Machine.Machine.GetAlgorithm(loadModel)
name_2 = AI.MachineLearning.Regression.SimpleLinearRegression.Name(getAlgorithm)
type = AI.MachineLearning.Regression.SimpleLinearRegression.Type(getAlgorithm)
isTrained = AI.Machine.Machine.IsTrained(loadModel)
resultDataType = AI.Machine.Machine.ResultDataType(loadModel)
