# Dynamo graph AI constructor test - save and load.dyn (Dynamo 2.0.2.6826)

# group: Training Data
input_values = CodeBlock()
# ---------- input_values.designscript (10 lines) ----------
[500,
3500,
4400,
4700,
5400,
3700,
6200,
5200,
6600,
6600];
# ----------------------------------------
corresponding_output_values = CodeBlock()
# ---------- corresponding_output_values.designscript (10 lines) ----------
[1000000,
1600000,
2200000,
2500000,
3100000,
3300000,
3500000,
2600000,
3000000,
4000000];
# ----------------------------------------

# group: Constructor
simpleLinearRegression = AI.Algorithms.Regression.SimpleLinearRegression.SimpleLinearRegression(inputList=input_values, outputList=corresponding_output_values)
code_block = CodeBlock { "TestMachine #1"; "simple machine"; }
machine = AI.Machine.Machine(algorithm=simpleLinearRegression, name=code_block.out0, description=code_block.out1)

# group: Learn
learn = AI.Machine.Learn(machine=machine)

# group: Test input
code_block_2 = CodeBlock { 500; }

# group: Predict
predict = AI.Machine.Predict(machine=learn, testData=code_block_2)

# group: Output location
file_path = Filename(".\AI constructor test.json")  # graph input

# group: IO
directoryName = FileSystem.DirectoryName(path=file_path)
string = StringInput("AI IO test - Simple Linear Regression.json")  # graph input
combinePath = FileSystem.CombinePath(path0=directoryName, path1=string)

# group: Save
# note: Note there is no connection between the 2 machines.
save = AI.Machine.Save(machine=predict.Machine, filePath=combinePath)

# group: Deserialise
load = AI.Machine.Load(filePath=combinePath)

# group: Inspect
name = AI.Machine.Name(machine=load)
description = AI.Machine.Description(machine=load)
GUID = AI.Machine.GUID(machine=load)
getAlgorithm = AI.Machine.GetAlgorithm(machine=load)
isTrained = AI.Machine.IsTrained(machine=load)

# group: Result 1
watch = Watch(predict.Result)

# group: Predict
predict_2 = AI.Machine.Predict(machine=load, testData=code_block_2)

# group: Result 2
watch_2 = Watch(predict_2.Result)

# group: Test result is the same
eq = watch == watch_2
watch_3 = Watch(eq)
