# Dynamo graph AI constructor test - save.dyn (Dynamo 2.0.2.6826)

# group: Training Data
input_values = CodeBlock()
# ---------- input_values.designscript (10 lines) ----------
[500,
3500,
4400,
4700,
5400,
3700,
6200,
5200,
6600,
6600];
# ----------------------------------------
corresponding_output_values = CodeBlock()
# ---------- corresponding_output_values.designscript (10 lines) ----------
[1000000,
1600000,
2200000,
2500000,
3100000,
3300000,
3500000,
2600000,
3000000,
4000000];
# ----------------------------------------

# group: Constructor
simpleLinearRegression = AI.Algorithms.Regression.SimpleLinearRegression.SimpleLinearRegression(inputList=input_values, outputList=corresponding_output_values)
code_block = CodeBlock { "TestMachine #1"; "simple machine"; }
machine = AI.Machine.Machine(algorithm=simpleLinearRegression, name=code_block.out0, description=code_block.out1)

# group: Learn
learn = AI.Machine.Learn(machine=machine)

# group: Inspect
GUID = AI.Machine.GUID(machine=learn)
name = AI.Machine.Name(machine=learn)
getAlgorithm = AI.Machine.GetAlgorithm(machine=learn)
name_2 = AI.Algorithms.Regression.SimpleLinearRegression.Name(simpleLinearRegression=getAlgorithm)
isTrainingDataLoaded = AI.Algorithms.Regression.SimpleLinearRegression.IsTrainingDataLoaded(simpleLinearRegression=getAlgorithm)

# group: Output location
file_path = Filename(".\AI constructor test.json")  # graph input

# group: IO
code_block_2 = CodeBlock(machine=learn) { machine; }
directoryName = FileSystem.DirectoryName(path=file_path)
string = StringInput("AI IO test - Simple Linear Regression.json")  # graph input
combinePath = FileSystem.CombinePath(path0=directoryName, path1=string)
save = AI.Machine.Save(machine=code_block_2, filePath=combinePath)
