# Dynamo graph AI constructor test NaiveBayes - save.dyn (Dynamo 1.3.0.875)

# group: Inputs
training_data = CodeBlock()
# ---------- training_data.designscript (16 lines) ----------
{
{ "Sunny", "Hot", "High", "Weak", "No" },
{ "Sunny", "Hot", "High", "Strong", "No" },
{ "Overcast", "Hot", "High", "Weak", "Yes" },
{ "Rain", "Mild", "High", "Weak", "Yes" },
{ "Rain", "Cool", "Normal", "Weak", "Yes" },
{ "Rain", "Cool", "Normal", "Strong", "No" },
{ "Overcast", "Cool", "Normal", "Strong", "Yes" },
{ "Sunny", "Mild", "High", "Weak", "No" },
{ "Sunny", "Cool", "Normal", "Weak", "Yes" },
{  "Rain", "Mild", "Normal", "Weak", "Yes" },
{  "Sunny", "Mild", "Normal", "Strong", "Yes" },
{  "Overcast", "Mild", "High", "Strong", "Yes" },
{  "Overcast", "Hot", "Normal", "Weak", "Yes" },
{  "Rain", "Mild", "High", "Strong", "No" }
};
# ----------------------------------------
# note: In this exercise, we will be using the famous Play Tennis example by Tom Mitchell (1998). In Mitchell's example, one would like to infer if a person would play tennis or not based solely on four input variables :
# - Outlook
# - Temperature
# - Humidity
# - Wind
# The rows of data presented below represent days on which the behavior of the person has been registered, pretty much building our set of observation instances for learning.
code_block = CodeBlock { { "Outlook", "Temperature", "Humidity", "Wind", "PlayTennis" }; }
code_block_2 = CodeBlock { "PlayTennis"; }
code_block_3 = CodeBlock { name="NaiveBayesMachine"; desc="simple machine"; file="AI IO test -"+name+".json"; }
file_path = Filename(".\AI constructor test.json")

# group: Build machine
naiveBayesClassifier = AI.Algorithms.Regression.NaiveBayesClassifier.NaiveBayesClassifier(training_data, code_block, code_block_2)
machine = AI.Machine.Machine(naiveBayesClassifier, code_block_3.name, code_block_3.desc)

# group: IO
code_block_4 = CodeBlock(machine=machine, filepath=code_block_3.file) { machine; filepath; }
directoryName = FilePath.DirectoryName(file_path)
combine = FilePath.Combine(directoryName, code_block_4.filepath)
saveModel = AI.Machine.SaveModel(code_block_4.machine, combine)

# group: Inspect
GUID = AI.Machine.GUID(machine)
name = AI.Machine.Name(machine)
getAlgorithm = AI.Machine.GetAlgorithm(machine)
name_2 = AI.Algorithms.Regression.SimpleLinearRegression.Name(getAlgorithm)
hasTrainingDataLoaded = AI.Algorithms.Regression.SimpleLinearRegression.HasTrainingDataLoaded(getAlgorithm)

# group: The input value to test
validation_line = CodeBlock()
# ---------- validation_line.designscript (5 lines) ----------
{"Overcast","Hot","High","Weak"};
 // result should be : yes

{"Sunny","Hot","High","Weak"};
 // result should be : no
# ----------------------------------------
