# Dynamo graph AI constructor test SimpleRegression - save.dyn (Dynamo 1.3.0.875)

# group: Inputs
code_block = CodeBlock { 1..10; 1..100; }
simpleLinearRegression = AI.Algorithms.Regression.SimpleLinearRegression.SimpleLinearRegression(code_block.out0, code_block.out0)
code_block_2 = CodeBlock { name="NaiveBayesMachine"; desc="simple machine"; file="AI IO test -"+name+".json"; }
file_path = Filename(".\AI constructor test.json")

# group: Build machine
machine = AI.Machine.Machine(simpleLinearRegression, code_block_2.name, code_block_2.desc)

# group: Inspect
GUID = AI.Machine.GUID(machine)
name = AI.Machine.Name(machine)
getAlgorithm = AI.Machine.GetAlgorithm(machine)
name_2 = AI.Algorithms.Regression.SimpleLinearRegression.Name(getAlgorithm)
isTrainingDataLoaded = AI.Algorithms.Regression.SimpleLinearRegression.IsTrainingDataLoaded(getAlgorithm)

# group: IO
code_block_3 = CodeBlock(machine=machine, filepath=code_block_2.file) { machine; filepath; }
directoryName = FilePath.DirectoryName(file_path)
combine = FilePath.Combine(directoryName, code_block_3.filepath)
save = AI.Machine.Save(code_block_3.machine, combine)
