# Dynamo graph AI constructor tests.dyn (Dynamo 1.3.0.875)

machineBase = AI.Machine.MachineBase.MachineBase()
code_block = CodeBlock { ""; }
regressionMachine = AI.MachineLearning.RegressionMachine.RegressionMachine(machineBase, code_block, code_block)
