# Dynamo graph AI learn test - Multiple Linear Regression.dyn (Dynamo 1.3.0.875)

# group: Inputs
code_block = CodeBlock()
# ---------- code_block.designscript (5 lines) ----------
{
{  1,  1,  1 },
{  2,  1,  1 },
{  3,  1,  1 }
};
# ----------------------------------------
code_block_2 = CodeBlock { { 1.0, 2.0,  3.0 }; }

# note: Inputs
code_block_3 = CodeBlock()
# ---------- code_block_3.designscript (16 lines) ----------
{
58698,
79699,
57849,
42261,
70305,
27614,
75715,
60786,
63625,
55631,
58266,
53099,
80921,
59105
};
# ----------------------------------------
code_block_4 = CodeBlock()
# ---------- code_block_4.designscript (16 lines) ----------
{
4100000,
2545662,
6393800,
2700000,
6135500,
2355700,
1069931,
6458346,
5575706,
5542872,
1104684,
2182716,
949840,
1685624
};
# ----------------------------------------
code_block_5 = CodeBlock()
# ---------- code_block_5.designscript (16 lines) ----------
{
365460,
445822,
342936,
394430,
422060,
269160,
474983,
462885,
496256,
406506,
565503,
450388,
697138,
452415
};
# ----------------------------------------

# group: Build list
create = List.Create(code_block_3, code_block_4, code_block_5)
transpose = List.Transpose(create)

# note: Results
code_block_6 = CodeBlock()
# ---------- code_block_6.designscript (16 lines) ----------
{
3075,
2400,
1750,
1800,
1900,
1700,
1250,
2500,
2650,
3000,
1650,
1150,
1700,
3400
};
# ----------------------------------------
code_block_7 = CodeBlock { ""; }
code_block_8 = CodeBlock { name="NaiveBayesMachine"; desc="simple machine"; file="AI IO test -"+name+" (trained).json"; }

# group: Build machine
multipleLinearRegression = AI.Algorithms.Regression.MultipleLinearRegression.MultipleLinearRegression(transpose, code_block_6, code_block_7)
machine = AI.Machine.Machine(multipleLinearRegression, code_block_8.name, code_block_8.desc)

# group: Learn
learn = AI.Machine.Learn(machine)

# group: The input value to test
code_block_9 = CodeBlock { { 59000,1685000,45000 }; }

# group: Predict
getAlgorithm = AI.Machine.GetAlgorithm(learn)
# note: Use the Predictor on the algorithm due to a bug in Dynamo's handling of data types.
# to be fixed later.
predict = AI.Algorithms.Regression.MultipleLinearRegression.Predict(getAlgorithm, code_block_9)
