# Dynamo graph AI learn test - NaiveBayes.dyn (Dynamo 1.3.0.875)

# group: Inputs
training_data = CodeBlock()
# ---------- training_data.designscript (16 lines) ----------
{
{ "Sunny", "Hot", "High", "Weak", "No" },
{ "Sunny", "Hot", "High", "Strong", "No" },
{ "Overcast", "Hot", "High", "Weak", "Yes" },
{ "Rain", "Mild", "High", "Weak", "Yes" },
{ "Rain", "Cool", "Normal", "Weak", "Yes" },
{ "Rain", "Cool", "Normal", "Strong", "No" },
{ "Overcast", "Cool", "Normal", "Strong", "Yes" },
{ "Sunny", "Mild", "High", "Weak", "No" },
{ "Sunny", "Cool", "Normal", "Weak", "Yes" },
{  "Rain", "Mild", "Normal", "Weak", "Yes" },
{  "Sunny", "Mild", "Normal", "Strong", "Yes" },
{  "Overcast", "Mild", "High", "Strong", "Yes" },
{  "Overcast", "Hot", "Normal", "Weak", "Yes" },
{  "Rain", "Mild", "High", "Strong", "No" }
};
# ----------------------------------------
code_block = CodeBlock { { "Outlook", "Temperature", "Humidity", "Wind", "PlayTennis" }; }
code_block_2 = CodeBlock { "PlayTennis"; }
# note: In this exercise, we will be using the famous Play Tennis example by Tom Mitchell (1998). In Mitchell's example, one would like to infer if a person would play tennis or not based solely on four input variables :
# - Outlook
# - Temperature
# - Humidity
# - Wind
# The rows of data presented below represent days on which the behavior of the person has been registered, pretty much building our set of observation instances for learning.
code_block_3 = CodeBlock { name="NaiveBayesMachine"; desc="simple machine"; file="AI IO test -"+name+" (trained).json"; }
file_path = Filename(".\AI constructor test.json")

# group: Build machine
naiveBayesClassifier = AI.Algorithms.Regression.NaiveBayesClassifier.NaiveBayesClassifier(training_data, code_block, code_block_2)
machine = AI.Machine.Machine(naiveBayesClassifier, code_block_3.name, code_block_3.desc)

# group: Learn
learn = AI.Machine.Learn(machine)

# group: IO
code_block_4 = CodeBlock(machine=learn, filepath=code_block_3.file) { machine; filepath; }
directoryName = FilePath.DirectoryName(file_path)
combine = FilePath.Combine(directoryName, code_block_4.filepath)
save = AI.Machine.Save(code_block_4.machine, combine)

# group: The input value to test
validation_line = CodeBlock()
# ---------- validation_line.designscript (5 lines) ----------
{"Overcast","Hot","High","Weak"};
 // result should be : yes

{"Sunny","Hot","High","Weak"};
 // result should be : no
# ----------------------------------------

# group: Predict
getAlgorithm = AI.Machine.GetAlgorithm(learn)
# note: Use the Predictor on the algorithm due to a bug in Dynamo's handling of data types.
# to be fixed later.
predict = AI.Algorithms.Regression.NaiveBayesClassifier.Predict(getAlgorithm, validation_line.out0)
